% Simulink data dictionary topLevel.sldd
% references commands.sldd
% references Controller.sldd

StateBus = Simulink.Bus()
  WorldPosition: double[3 1]
  WorldVelocity: double[3 1]
  EulerZYX: double[3 1]
  Thrust: double[3 1]

ControlBus = Simulink.Bus()
  Roll: double
  Pitch: double
  Yaw: double
  Thrust: double[3 1]

EnvironmentBus = Simulink.Bus()
  Gravity: double